# Grasshopper definition Curtain Walls_Native.ghx (Grasshopper 1.0.7)
# plug-ins: Rhino.Inside for Autodesk Revit

model = ModelCategoriesPicker({"Air Systems": -2001008, "Air Terminals": -2008013, "Analysis Display Style": -2000304, "Analysis Results": -2000303, "Areas": -2003200, "Bridge Abutments": -2006130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}, selected="Curtain Grids": -2000173)  # disabled
model_2 = ModelCategoriesPicker({"Air Systems": -2001008, "Air Terminals": -2008013, "Analysis Display Style": -2000304, "Analysis Results": -2000303, "Areas": -2003200, "Bridge Abutments": -2006130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}, selected="Curtain Panels": -2000170)  # disabled
model_3 = ModelCategoriesPicker({"Air Systems": -2001008, "Air Terminals": -2008013, "Analysis Display Style": -2000304, "Analysis Results": -2000303, "Areas": -2003200, "Bridge Abutments": -2006130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}, selected="Curtain Wall Mullions": -2000171)  # disabled
# PARTS (TYPE, INSTANCE)
model_4 = ModelCategoriesPicker({"Air Systems": -2001008, "Air Terminals": -2008013, "Analysis Display Style": -2000304, "Analysis Results": -2000303, "Areas": -2003200, "Bridge Abutments": -2006130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}, selected="Curtain Grids": -2000173)  # disabled
model_5 = ModelCategoriesPicker({"Air Systems": -2001008, "Air Terminals": -2008013, "Analysis Display Style": -2000304, "Analysis Results": -2000303, "Areas": -2003200, "Bridge Abutments": -2006130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}, selected="Curtain Panels": -2000170)  # disabled
model_6 = ModelCategoriesPicker({"Air Systems": -2001008, "Air Terminals": -2008013, "Analysis Display Style": -2000304, "Analysis Results": -2000303, "Areas": -2003200, "Bridge Abutments": -2006130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}, selected="Curtain Wall Mullions": -2000171)  # disabled
# CURTAIN WALLS AND TYPES
wall_system_family = WallSystemFamily({"Basic": 0, "Curtain": 1, "Stacked": 2}, selected="Curtain")  # disabled
model_7 = ModelCategoriesPicker({"Air Systems": -2001008, "Air Terminals": -2008013, "Analysis Display Style": -2000304, "Analysis Results": -2000303, "Areas": -2003200, "Bridge Abutments": -2006130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}, selected="Curtain Systems": -2000340)  # disabled
# CURTAIN SYSTEMS AND TYPES
model_8 = ModelCategoriesPicker({"Air Systems": -2001008, "Air Terminals": -2008013, "Analysis Display Style": -2000304, "Analysis Results": -2000303, "Areas": -2003200, "Bridge Abutments": -2006130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}, selected="Curtain Systems": -2000340)  # disabled
walls = DocumentWalls(WallSystemFamily=wall_system_family)  # disabled
bycategory = ElementCategoryFilter(Categories=model_4, Inverted=False)  # disabled
bycategory_2 = ElementCategoryFilter(Categories=model_5, Inverted=False)  # disabled
bycategory_3 = ElementCategoryFilter(Categories=model_6, Inverted=False)  # disabled
bycategory_4 = ElementCategoryFilter(Categories=model, Inverted=False)  # disabled
bycategory_5 = ElementCategoryFilter(Categories=model_2, Inverted=False)  # disabled
bycategory_6 = ElementCategoryFilter(Categories=model_3, Inverted=False)  # disabled
bycategory_7 = ElementCategoryFilter(Categories=model_8, Inverted=False)  # disabled
bycategory_8 = ElementCategoryFilter(Categories=model_7, Inverted=False)  # disabled
types = QueryTypes(Filter=bycategory)  # disabled
types_2 = QueryTypes(Filter=bycategory_2)  # disabled
types_3 = QueryTypes(Filter=bycategory_3)  # disabled
elements = DocumentElements(Filter=bycategory_4)  # disabled
elements_2 = DocumentElements(Filter=bycategory_5)  # disabled
elements_3 = DocumentElements(Filter=bycategory_6)  # disabled
identity = ElementIdentity(Element=walls)  # -> Category, Type, Name; disabled
panel = Panel(walls)  # disabled
types_4 = QueryTypes(Filter=bycategory_7)  # disabled
elements_4 = QueryElements(Filter=bycategory_8)  # disabled
panel_2 = Panel(types)  # disabled
panel_3 = Panel(types_2)  # disabled
panel_4 = Panel(types_3)  # disabled
panel_5 = Panel(identity.Type)  # disabled
panel_6 = Panel(elements)  # disabled
panel_7 = Panel(elements_2)  # disabled
panel_8 = Panel(elements_3)  # disabled
panel_9 = Panel(types_4)  # disabled
panel_10 = Panel(elements_4)  # disabled
wall_system_family_2 = WallSystemFamily({"Basic": 0, "Curtain": 1, "Stacked": 2}, selected="Curtain")  # disabled
wall_system_family_3 = WallSystemFamily({"Basic": 0, "Curtain": 1, "Stacked": 2}, selected="Curtain")  # disabled
# GRID CELLS
wall_system_family_4 = WallSystemFamily({"Basic": 0, "Curtain": 1, "Stacked": 2}, selected="Curtain")  # disabled
wall_system_family_5 = WallSystemFamily({"Basic": 0, "Curtain": 1, "Stacked": 2}, selected="Curtain")  # disabled
wall_system_family_6 = WallSystemFamily({"Basic": 0, "Curtain": 1, "Stacked": 2}, selected="Curtain")  # disabled
wall_system_family_7 = WallSystemFamily({"Basic": 0, "Curtain": 1, "Stacked": 2}, selected="Curtain")  # disabled
# CURTAIN GRID
wall_system_family_8 = WallSystemFamily({"Basic": 0, "Curtain": 1, "Stacked": 2}, selected="Curtain")  # disabled
wall_system_family_9 = WallSystemFamily({"Basic": 0, "Curtain": 1, "Stacked": 2}, selected="Curtain")  # disabled
wall_system_family_10 = WallSystemFamily({"Basic": 0, "Curtain": 1, "Stacked": 2}, selected="Curtain")  # disabled
walls_2 = DocumentWalls(WallSystemFamily=wall_system_family_2)  # disabled
# INSTANCES
level_of_detail = LevelOfDetail({"Coarse": 1, "Medium": 2, "Fine": 3}, selected="Fine")  # disabled
walls_3 = DocumentWalls(WallSystemFamily=wall_system_family_3)  # disabled
walls_4 = DocumentWalls(WallSystemFamily=wall_system_family_4)  # disabled
walls_5 = DocumentWalls(WallSystemFamily=wall_system_family_6)  # disabled
walls_6 = DocumentWalls(WallSystemFamily=wall_system_family_7)  # disabled
walls_7 = DocumentWalls(WallSystemFamily=wall_system_family_8)  # disabled
walls_8 = DocumentWalls(WallSystemFamily=wall_system_family_5)  # disabled
walls_9 = DocumentWalls(WallSystemFamily=wall_system_family_9)  # disabled
identity_2 = ElementIdentity(Element=walls_2)  # -> Category, Type, Name; disabled
walls_10 = DocumentWalls(WallSystemFamily=wall_system_family_10)  # disabled
analyze_curtain_wall = AnalyzeCurtainWall(CurtainWall=walls_3)  # -> CurtainGrid, HostWall; disabled
analyze_curtain_wall_2 = AnalyzeCurtainWall(CurtainWall=walls_4)  # -> CurtainGrid, HostWall; disabled
analyze_curtain_wall_3 = AnalyzeCurtainWall(CurtainWall=walls_9)  # -> CurtainGrid, HostWall; disabled
# CURTAIN WALLS
# TYPES
a_cwt = AnalyzeCurtainWallType(CurtainWallType=identity_2.Type)  # -> Function, AutomaticallyEmbed, CurtainPanel, JoinCondition, VerticalGridLayout, VerticalGridSpacing, VerticalGridAdjustForMullionSize, HorizontalGridLayout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; disabled
geometry = ElementGeometry(DetailLevel=level_of_detail, Elements=walls_8)  # disabled
ebg = ElementBoundingGeometry(Element=walls_5)  # disabled
analyze_curtain_wall_4 = AnalyzeCurtainWall(CurtainWall=walls_6)  # -> CurtainGrid, HostWall; disabled
analyze_curtain_wall_5 = AnalyzeCurtainWall(CurtainWall=walls_7)  # -> CurtainGrid, HostWall; disabled
analyze_curtain_wall_6 = AnalyzeCurtainWall(CurtainWall=walls_10)  # -> CurtainGrid, HostWall; disabled
analyze_curtain_grid = AnalyzeCurtainGrid(CurtainGrid=analyze_curtain_wall.CurtainGrid)  # -> Cells, Mullions, Panels, VerticalLines, VerticalAngle, VerticalJustification, VerticalOffset, HorizontalLines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; disabled
analyze_curtain_grid_2 = AnalyzeCurtainGrid(CurtainGrid=analyze_curtain_wall_2.CurtainGrid)  # -> Cells, Mullions, Panels, VerticalLines, VerticalAngle, VerticalJustification, VerticalOffset, HorizontalLines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; disabled
analyze_curtain_grid_3 = AnalyzeCurtainGrid(CurtainGrid=analyze_curtain_wall_3.CurtainGrid)  # -> Cells, Mullions, Panels, VerticalLines, VerticalAngle, VerticalJustification, VerticalOffset, HorizontalLines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; disabled
analyze_curtain_grid_4 = AnalyzeCurtainGrid(CurtainGrid=analyze_curtain_wall_6.CurtainGrid)  # -> Cells, Mullions, Panels, VerticalLines, VerticalAngle, VerticalJustification, VerticalOffset, HorizontalLines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; disabled
panel_11 = Panel(geometry)  # disabled
bounding_geometry = Panel(ebg)  # disabled
host_wall = Panel(analyze_curtain_wall_5.HostWall)  # disabled
curtain_grid = Panel(analyze_curtain_wall_4.CurtainGrid)  # disabled
analyze_curtain_grid_cell = AnalyzeCurtainGridCell(CurtainGridCell=analyze_curtain_grid_3.Cells)  # -> Curves, PlanarizedCurves; disabled
analyze_curtain_grid_cell_2 = AnalyzeCurtainGridCell(CurtainGridCell=analyze_curtain_grid_4.Cells)  # -> Curves, PlanarizedCurves; disabled
path_mapper = PathMapper(
    [a_cwt.VerticalGridLayout, a_cwt.VerticalGridSpacing, a_cwt.VerticalGridAdjustForMullionSize],
    source="{A;B}(i)",
    target="{A;B;i}")  # disabled
path_mapper_2 = PathMapper(
    [a_cwt.HorizontalGridLayout, a_cwt.HorizontalGridSpacing, a_cwt.HorizontalGridAdjustForMullionSize],
    source="{A;B}(i)",
    target="{A;B;i}")  # disabled
path_mapper_3 = PathMapper(
    [a_cwt.VerticalMullionsInteriorType, a_cwt.VerticalMullionsBorder1Type, a_cwt.VerticalMullionsBorder2Type],
    source="{A;B}(i)",
    target="{A;B;i}")  # disabled
path_mapper_4 = PathMapper(
    [a_cwt.HorizontalMullionsInteriorType, a_cwt.HorizontalMullionsBorder1Type, a_cwt.HorizontalMullionsBorder2Type],
    source="{A;B}(i)",
    target="{A;B;i}")  # disabled
wall_function = Panel(a_cwt.Function)  # disabled
automatically_embed = Panel(a_cwt.AutomaticallyEmbed)  # disabled
curtain_panel_type = Panel(a_cwt.CurtainPanel)  # disabled
curtain_join_condition = Panel(a_cwt.JoinCondition)  # disabled
grid_cells = Panel(analyze_curtain_grid.Cells)  # disabled
grid_mullions = Panel(analyze_curtain_grid.Mullions)  # disabled
grid_inserts = Panel(analyze_curtain_grid.Panels)  # disabled
u_grid_lines = Panel(analyze_curtain_grid.VerticalLines)  # disabled
path_mapper_5 = PathMapper(
    [analyze_curtain_grid.VerticalAngle, analyze_curtain_grid.VerticalJustification, analyze_curtain_grid.VerticalOffset],
    source="{A;B}(i)",
    target="{A;B;i}")  # disabled
v_grid_lines = Panel(analyze_curtain_grid.HorizontalLines)  # disabled
path_mapper_6 = PathMapper(
    [analyze_curtain_grid.HorizontalAngle, analyze_curtain_grid.HorizontalJustification, analyze_curtain_grid.HorizontalOffset],
    source="{A;B}(i)",
    target="{A;B;i}")  # disabled
cell_curve = Panel(analyze_curtain_grid_cell.Curves)  # disabled
swatch = ColourSwatch(SwatchColor=RGB(255, 255, 255))  # disabled
grid_cell_geom = CustomPreview(Geometry=analyze_curtain_grid_cell.Curves, Material=swatch)  # disabled
lng = ListLength(List=analyze_curtain_grid_2.Cells)  # disabled
cell_count = Panel(lng)  # disabled
u_grid_info = Panel(path_mapper)  # disabled
v_grid_info = Panel(path_mapper_2)  # disabled
u_mullion_info = Panel(path_mapper_3)  # disabled
v_mullion_info = Panel(path_mapper_4)  # disabled
center_planes = BoundarySurfaces(Edges=analyze_curtain_grid_cell_2.PlanarizedCurves, UseTasks=False)  # disabled
cell_panel_curve = Panel(analyze_curtain_grid_cell_2.PlanarizedCurves)  # disabled
u_grid_info_2 = Panel(path_mapper_5)  # disabled
v_grid_info_2 = Panel(path_mapper_6)  # disabled
wf = WallFunction({"Interior": 0, "Exterior": 1, "Foundation": 2, "Retaining": 3, "Soffit": 4, "Core-Shaft": 5}, selected="Interior")  # disabled
analyze_curtain_grid_cell_3 = AnalyzeCurtainGridCell(CurtainGridCell=analyze_curtain_grid_2.Cells)  # -> Curves, PlanarizedCurves; disabled
swatch_2 = ColourSwatch(SwatchColor=RGBA(219, 0, 255, 23))  # disabled
amoments = AreaMoments(Geometry=center_planes)  # -> Area, Centroid, Inertia, InertiaError, Secondary, SecondaryError, Gyration; disabled
cell_plane = CustomPreview(Geometry=center_planes, Material=swatch_2)  # disabled
pshift = ShiftPaths(Data=amoments.Centroid, Offset=-1)  # disabled
cgjc = CurtainGridJoinCondition({"Not Defined": 0, "Vertical Grid Continuous": 1, "Horizontal Grid Continuous": 2, "Border & Vertical Grid Continuous": 3, "Border & Horizontal Grid Continuous": 4}, selected="Not Defined")  # disabled
cell_curve_2 = Panel(analyze_curtain_grid_cell_3.Curves)  # disabled
cell_panel_curve_2 = Panel(analyze_curtain_grid_cell_3.PlanarizedCurves)  # disabled
points = PointList(Points=pshift)  # disabled
# = Layout
# = Spacing
# = Adjust for Mullion Size
cgl = CurtainGridLayout({"None": 0, "Fixed Distance": 1, "Fixed Number": 2, "Maximum Spacing": 3, "Minimum Spacing": 4}, selected="None")  # disabled
# = Layout
# = Spacing
# = Adjust for Mullion Size
# = Inteiror Mullion Type
# = Start Mullion Type (Border 1)
# = End Mullion Type (Border 2)
# = Inteiror Mullion Type
# = Bottom Mullion Type (Border 1)
# = Top Mullion Type (Border 2)
cgl_2 = CurtainGridLayout({"None": 0, "Fixed Distance": 1, "Fixed Number": 2, "Maximum Spacing": 3, "Minimum Spacing": 4}, selected="None")  # disabled
# = Grid Angle
# = Grid Justification
# = Grid Offset
cgat = CurtainGridAlignType({"No Justify": 0, "Beginning": 1, "Center": 2, "End": 3}, selected="No Justify")  # disabled
# = Grid Angle
# = Grid Justification
# = Grid Offset
cgat_2 = CurtainGridAlignType({"No Justify": 0, "Beginning": 1, "Center": 2, "End": 3}, selected="No Justify")  # disabled
wall_system_family_11 = WallSystemFamily({"Basic": 0, "Curtain": 1, "Stacked": 2}, selected="Curtain")  # disabled
wall_system_family_12 = WallSystemFamily({"Basic": 0, "Curtain": 1, "Stacked": 2}, selected="Curtain")  # disabled
# MULLIONS
wall_system_family_13 = WallSystemFamily({"Basic": 0, "Curtain": 1, "Stacked": 2}, selected="Curtain")  # disabled
wall_system_family_14 = WallSystemFamily({"Basic": 0, "Curtain": 1, "Stacked": 2}, selected="Curtain")  # disabled
# TYPES
wall_system_family_15 = WallSystemFamily({"Basic": 0, "Curtain": 1, "Stacked": 2}, selected="Curtain")  # disabled
wall_system_family_16 = WallSystemFamily({"Basic": 0, "Curtain": 1, "Stacked": 2}, selected="Curtain")  # disabled
walls_11 = DocumentWalls(WallSystemFamily=wall_system_family_11)  # disabled
walls_12 = DocumentWalls(WallSystemFamily=wall_system_family_12)  # disabled
walls_13 = DocumentWalls(WallSystemFamily=wall_system_family_13)  # disabled
walls_14 = DocumentWalls(WallSystemFamily=wall_system_family_14)  # disabled
walls_15 = DocumentWalls(WallSystemFamily=wall_system_family_15)  # disabled
walls_16 = DocumentWalls(WallSystemFamily=wall_system_family_16)  # disabled
analyze_curtain_wall_7 = AnalyzeCurtainWall(CurtainWall=walls_11)  # -> CurtainGrid, HostWall; disabled
analyze_curtain_wall_8 = AnalyzeCurtainWall(CurtainWall=walls_12)  # -> CurtainGrid, HostWall; disabled
analyze_curtain_wall_9 = AnalyzeCurtainWall(CurtainWall=walls_13)  # -> CurtainGrid, HostWall; disabled
analyze_curtain_wall_10 = AnalyzeCurtainWall(CurtainWall=walls_14)  # -> CurtainGrid, HostWall; disabled
analyze_curtain_wall_11 = AnalyzeCurtainWall(CurtainWall=walls_15)  # -> CurtainGrid, HostWall; disabled
analyze_curtain_wall_12 = AnalyzeCurtainWall(CurtainWall=walls_16)  # -> CurtainGrid, HostWall; disabled
analyze_curtain_grid_5 = AnalyzeCurtainGrid(CurtainGrid=analyze_curtain_wall_7.CurtainGrid)  # -> Cells, Mullions, Panels, VerticalLines, VerticalAngle, VerticalJustification, VerticalOffset, HorizontalLines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; disabled
analyze_curtain_grid_6 = AnalyzeCurtainGrid(CurtainGrid=analyze_curtain_wall_9.CurtainGrid)  # -> Cells, Mullions, Panels, VerticalLines, VerticalAngle, VerticalJustification, VerticalOffset, HorizontalLines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; disabled
analyze_curtain_grid_7 = AnalyzeCurtainGrid(CurtainGrid=analyze_curtain_wall_8.CurtainGrid)  # -> Cells, Mullions, Panels, VerticalLines, VerticalAngle, VerticalJustification, VerticalOffset, HorizontalLines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; disabled
analyze_curtain_grid_8 = AnalyzeCurtainGrid(CurtainGrid=analyze_curtain_wall_10.CurtainGrid)  # -> Cells, Mullions, Panels, VerticalLines, VerticalAngle, VerticalJustification, VerticalOffset, HorizontalLines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; disabled
analyze_curtain_grid_9 = AnalyzeCurtainGrid(CurtainGrid=analyze_curtain_wall_11.CurtainGrid)  # -> Cells, Mullions, Panels, VerticalLines, VerticalAngle, VerticalJustification, VerticalOffset, HorizontalLines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; disabled
analyze_curtain_grid_10 = AnalyzeCurtainGrid(CurtainGrid=analyze_curtain_wall_12.CurtainGrid)  # -> Cells, Mullions, Panels, VerticalLines, VerticalAngle, VerticalJustification, VerticalOffset, HorizontalLines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; disabled
crv = Curve(analyze_curtain_grid_6.Mullions)  # disabled
geometry_2 = ElementGeometry(Elements=analyze_curtain_grid_5.Mullions)  # disabled
analyze_mullion = AnalyzeMullion(Mullion=analyze_curtain_grid_7.Mullions)  # -> Type, AxisCurve, BasePoint; disabled
analyze_mullion_2 = AnalyzeMullion(Mullion=analyze_curtain_grid_8.Mullions)  # -> Type, AxisCurve, BasePoint; disabled
analyze_mullion_3 = AnalyzeMullion(Mullion=analyze_curtain_grid_9.Mullions)  # -> Type, AxisCurve, BasePoint; disabled
analyze_mullion_4 = AnalyzeMullion(Mullion=analyze_curtain_grid_10.Mullions)  # -> Type, AxisCurve, BasePoint; disabled
swatch_3 = ColourSwatch(SwatchColor=RGBA(0, 112, 255, 101))  # disabled
grid_mullion_geom = CustomPreview(Geometry=geometry_2, Material=swatch_3)  # disabled
mullion_base_curves = Panel(crv)  # disabled
len = Length(Curve=crv)  # disabled
analyze_mullion_type = AnalyzeMullionType(MullionType=analyze_mullion_3.Type)  # -> MullionSystemFamily, Angle, Offset, Profile, Position, CornerMullion, Thickness, Depth1, Depth2, Radius; disabled
midpt = CurveMiddle(Curve=analyze_mullion.AxisCurve)  # disabled
mullion_base_curves_2 = Panel(analyze_mullion.AxisCurve)  # disabled
analyze_mullion_type_2 = AnalyzeMullionType(MullionType=analyze_mullion_4.Type)  # -> MullionSystemFamily, Angle, Offset, Profile, Position, CornerMullion, Thickness, Depth1, Depth2, Radius; disabled
path_mapper_7 = PathMapper(analyze_mullion_2.BasePoint, source="{A;B;C}(i)", target="{A;B;C;i}")  # disabled
type = Panel(analyze_mullion_2.Type)  # disabled
base_curve = Panel(analyze_mullion_2.AxisCurve)  # disabled
bool = Boolean(invert(len))  # disabled
points_2 = PointList(Points=midpt)  # disabled
cull = CullPattern(List=len, CullPattern=bool)  # disabled
path_mapper_8 = PathMapper(
    [analyze_mullion_type.MullionSystemFamily, analyze_mullion_type.Angle, analyze_mullion_type.Offset, analyze_mullion_type.Profile, analyze_mullion_type.Position, analyze_mullion_type.CornerMullion, analyze_mullion_type.Thickness, analyze_mullion_type.Depth1, analyze_mullion_type.Depth2, analyze_mullion_type.Radius],
    source="{A;B;C}(i)",
    target="{A;B;C;i}")  # disabled
# = Base Point
# = Locked?
# = Lockable?
mullion_info = Panel(path_mapper_7)  # disabled
mullion_base_curve_length = Panel(cull)  # disabled
cmsf = CurtainMullionSystemFamily({"Unknown": -1, "Rectangular": 0, "Circular": 1, "L Corner": 2, "Trapezoid Corner": 3, "Quad Corner": 4, "V Corner": 5}, selected="L Corner")  # disabled
mullion_type_properties = Panel(path_mapper_8)  # disabled
equals = Equality(FirstNumber=analyze_mullion_type_2.MullionSystemFamily, SecondNumber=cmsf)  # -> Equality, Inequality; disabled
cull_2 = CullPattern(List=analyze_curtain_grid_10.Mullions, CullPattern=equals.Equality)  # disabled
panel_12 = Panel(cull_2)  # disabled
# = System Family
# = Angle
# = Offset
# = Profile
# = Position
# = Corner Mullion
# = Thickness
# = Dimension 1
# = Dimension 2
# = Radius
cmsf_2 = CurtainMullionSystemFamily({"Unknown": -1, "Rectangular": 0, "Circular": 1, "L Corner": 2, "Trapezoid Corner": 3, "Quad Corner": 4, "V Corner": 5}, selected="Unknown")  # disabled
cmp = CurtainMullionPosition({"Parallel to Ground": 0, "Perpendicular to Face": 1}, selected="Parallel to Ground")  # disabled
# PANELS
wall_system_family_17 = WallSystemFamily({"Basic": 0, "Curtain": 1, "Stacked": 2}, selected="Curtain")  # disabled
wall_system_family_18 = WallSystemFamily({"Basic": 0, "Curtain": 1, "Stacked": 2}, selected="Curtain")  # disabled
wall_system_family_19 = WallSystemFamily({"Basic": 0, "Curtain": 1, "Stacked": 2}, selected="Curtain")
# TYPES
wall_system_family_20 = WallSystemFamily({"Basic": 0, "Curtain": 1, "Stacked": 2}, selected="Curtain")  # disabled
wall_system_family_21 = WallSystemFamily({"Basic": 0, "Curtain": 1, "Stacked": 2}, selected="Curtain")  # disabled
wall_system_family_22 = WallSystemFamily({"Basic": 0, "Curtain": 1, "Stacked": 2}, selected="Curtain")  # disabled
walls_17 = DocumentWalls(WallSystemFamily=wall_system_family_17)  # disabled
walls_18 = DocumentWalls(WallSystemFamily=wall_system_family_18)  # disabled
walls_19 = DocumentWalls(WallSystemFamily=wall_system_family_19)
walls_20 = DocumentWalls(WallSystemFamily=wall_system_family_20)  # disabled
walls_21 = DocumentWalls(WallSystemFamily=wall_system_family_21)  # disabled
walls_22 = DocumentWalls(WallSystemFamily=wall_system_family_22)  # disabled
analyze_curtain_wall_13 = AnalyzeCurtainWall(CurtainWall=walls_17)  # -> CurtainGrid, HostWall; disabled
analyze_curtain_wall_14 = AnalyzeCurtainWall(CurtainWall=walls_18)  # -> CurtainGrid, HostWall; disabled
analyze_curtain_wall_15 = AnalyzeCurtainWall(CurtainWall=walls_19)  # -> CurtainGrid, HostWall
analyze_curtain_wall_16 = AnalyzeCurtainWall(CurtainWall=walls_20)  # -> CurtainGrid, HostWall; disabled
analyze_curtain_wall_17 = AnalyzeCurtainWall(CurtainWall=walls_21)  # -> CurtainGrid, HostWall; disabled
analyze_curtain_wall_18 = AnalyzeCurtainWall(CurtainWall=walls_22)  # -> CurtainGrid, HostWall; disabled
model_9 = ModelCategoriesPicker({"Air Systems": -2001008, "Air Terminals": -2008013, "Analysis Display Style": -2000304, "Analysis Results": -2000303, "Areas": -2003200, "Bridge Abutments": -2006130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}, selected="Curtain Systems": -2000340)  # disabled
model_10 = ModelCategoriesPicker({"Air Systems": -2001008, "Air Terminals": -2008013, "Analysis Display Style": -2000304, "Analysis Results": -2000303, "Areas": -2003200, "Bridge Abutments": -2006130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}, selected="Curtain Systems": -2000340)  # disabled
# CURTAIN SYSTEMS
model_11 = ModelCategoriesPicker({"Air Systems": -2001008, "Air Terminals": -2008013, "Analysis Display Style": -2000304, "Analysis Results": -2000303, "Areas": -2003200, "Bridge Abutments": -2006130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}, selected="Curtain Systems": -2000340)  # disabled
analyze_curtain_grid_11 = AnalyzeCurtainGrid(CurtainGrid=analyze_curtain_wall_13.CurtainGrid)  # -> Cells, Mullions, Panels, VerticalLines, VerticalAngle, VerticalJustification, VerticalOffset, HorizontalLines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; disabled
analyze_curtain_grid_12 = AnalyzeCurtainGrid(CurtainGrid=analyze_curtain_wall_14.CurtainGrid)  # -> Cells, Mullions, Panels, VerticalLines, VerticalAngle, VerticalJustification, VerticalOffset, HorizontalLines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; disabled
analyze_curtain_grid_13 = AnalyzeCurtainGrid(CurtainGrid=analyze_curtain_wall_15.CurtainGrid)  # -> Cells, Mullions, Panels, VerticalLines, VerticalAngle, VerticalJustification, VerticalOffset, HorizontalLines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
analyze_curtain_grid_14 = AnalyzeCurtainGrid(CurtainGrid=analyze_curtain_wall_16.CurtainGrid)  # -> Cells, Mullions, Panels, VerticalLines, VerticalAngle, VerticalJustification, VerticalOffset, HorizontalLines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; disabled
analyze_curtain_grid_15 = AnalyzeCurtainGrid(CurtainGrid=analyze_curtain_wall_17.CurtainGrid)  # -> Cells, Mullions, Panels, VerticalLines, VerticalAngle, VerticalJustification, VerticalOffset, HorizontalLines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; disabled
analyze_curtain_grid_16 = AnalyzeCurtainGrid(CurtainGrid=analyze_curtain_wall_18.CurtainGrid)  # -> Cells, Mullions, Panels, VerticalLines, VerticalAngle, VerticalJustification, VerticalOffset, HorizontalLines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; disabled
analyze_panel = AnalyzePanel(Panel=analyze_curtain_grid_13.Panels)  # -> Type, HostPanel, BasePoint, Orientation, Width, Height
panel_13 = Panel(analyze_curtain_grid_12.Panels)  # disabled
geometry_3 = ElementGeometry(Elements=analyze_curtain_grid_11.Panels)  # disabled
analyze_panel_2 = AnalyzePanel(Panel=analyze_curtain_grid_15.Panels)  # -> Type, HostPanel, BasePoint, Orientation, Width, Height; disabled
analyze_panel_3 = AnalyzePanel(Panel=analyze_curtain_grid_16.Panels)  # -> Type, HostPanel, BasePoint, Orientation, Width, Height; disabled
analyze_panel_4 = AnalyzePanel(Panel=analyze_curtain_grid_14.Panels)  # -> Type, HostPanel, BasePoint, Orientation, Width, Height; disabled
geometry_4 = ElementGeometry(Elements=analyze_curtain_grid_14.Panels)  # disabled
bycategory_9 = ElementCategoryFilter(Categories=model_10, Inverted=False)  # disabled
bycategory_10 = ElementCategoryFilter(Categories=model_11, Inverted=False)  # disabled
bycategory_11 = ElementCategoryFilter(Categories=model_9, Inverted=False)  # disabled
panel_14 = Panel(analyze_panel_2.Type)  # disabled
a_cgpt = AnalyzeCurtainGridPanelType(CurtainGridPanelType=analyze_panel_3.Type)  # -> PanelSystemFamily, Offset, Thickness; disabled
swatch_4 = ColourSwatch(SwatchColor=RGBA(219, 0, 255, 23))  # disabled
grid_insert_geom = CustomPreview(Geometry=geometry_3, Material=swatch_4)  # disabled
elements_5 = DocumentElements(Filter=bycategory_10)  # disabled
elements_6 = DocumentElements(Filter=bycategory_11)  # disabled
types_5 = QueryTypes(Filter=bycategory_9)  # disabled
item = ListItem(List=geometry_4, Index=0, Wrap=True)  # disabled
swatch_5 = ColourSwatch(SwatchColor=RGBA(219, 0, 255, 23))  # disabled
grid_insert_geom_2 = CustomPreview(Geometry=geometry_4, Material=swatch_5)  # disabled
host_panel = Panel(analyze_panel.HostPanel)
panel_base_point = Panel(analyze_panel.BasePoint)
panel_orientation_vector = Panel(analyze_panel.Orientation)
panel_symbol = Panel(analyze_panel.Type)
path_mapper_9 = PathMapper([analyze_panel.Width, analyze_panel.Height], source="{A;B;C}(i)", target="{A;B;C;i}")
path_mapper_10 = PathMapper([a_cgpt.PanelSystemFamily, a_cgpt.Offset, a_cgpt.Thickness], source="{A;B;C}(i)", target="{A;B;C;i}")  # disabled
cset = CreateSet(List=panel_13)  # -> Set, Map; disabled
a_cst = AnalyzeCurtainSystemType(CurtainSystemType=types_5)  # -> CurtainPanel, JoinCondition, Grid1Layout, Grid1Spacing, Grid1AdjustForMullionSize, Grid2Layout, Grid2Spacing, Grid2AdjustForMullionSize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; disabled
pshift_2 = ShiftPaths(Data=item, Offset=-1)  # disabled
analyze_curtain_system = AnalyzeCurtainSystem(CurtainSystem=elements_5)  # disabled
analyze_curtain_system_2 = AnalyzeCurtainSystem(CurtainSystem=elements_6)  # disabled
grid_insert_types = Panel(cset.Set)  # disabled
panel_centroids = VolumeMoments(Geometry=pshift_2, UseTasks=True)  # -> Volume, Centroid, Inertia, InertiaError, Secondary, SecondaryError, Gyration; disabled
panel_15 = Panel(analyze_curtain_system)  # disabled
analyze_curtain_grid_17 = AnalyzeCurtainGrid(CurtainGrid=analyze_curtain_system_2)  # -> CurtainGridCells, CurtainGridMullions, CurtainGridPanels, CurtainGridLinesAlongUAxis, CurtainGridAngleUAxisGrid1, CurtainGridAlignmentTypeUAxisGrid1, CurtainGridOffsetUAxisGrid1, CurtainGridLinesAlongVAxis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; disabled
# = Panel System Family
# = Offset
# = Thickness
mullion_type_properties_2 = Panel(path_mapper_10)  # disabled
path_mapper_11 = PathMapper([a_cst.Grid1Layout, a_cst.Grid1Spacing, a_cst.Grid1AdjustForMullionSize], source="{A;B}(i)", target="{A;B;i}")  # disabled
path_mapper_12 = PathMapper([a_cst.Grid2Layout, a_cst.Grid2Spacing, a_cst.Grid2AdjustForMullionSize], source="{A;B}(i)", target="{A;B;i}")  # disabled
path_mapper_13 = PathMapper(
    [a_cst.Grid1MullionsInteriorType, a_cst.Grid1MullionsBorder1Type, a_cst.Grid1MullionsBorder2Type],
    source="{A;B}(i)",
    target="{A;B;i}")  # disabled
path_mapper_14 = PathMapper(
    [a_cst.Grid2MullionsInteriorType, a_cst.Grid2MullionsBorder1Type, a_cst.Grid2MullionsBorder2Type],
    source="{A;B}(i)",
    target="{A;B;i}")  # disabled
curtain_join_condition_2 = Panel(a_cst.JoinCondition)  # disabled
curtain_panel_type_2 = Panel(a_cst.CurtainPanel)  # disabled
panel_16 = Panel(analyze_curtain_grid_17.CurtainGridPanels)  # disabled
swatch_6 = ColourSwatch(SwatchColor=RGB(255, 255, 0))  # disabled
swatch_7 = ColourSwatch(SwatchColor=RGB(89, 0, 255))  # disabled
# = Lockable?
# = Width
# = Height
panel_info = Panel(path_mapper_9)
cset_2 = CreateSet(List=panel_14)  # -> Set, Map; disabled
panel_17 = Panel(cset_2.Set)  # disabled
panel_normals = VectorDisplayEx(Point=analyze_panel_4.BasePoint, Vector=analyze_panel_4.Orientation, Colour=swatch_7, Width=1)  # disabled
panel_normals_2 = VectorDisplayEx(Point=panel_centroids.Centroid, Vector=analyze_panel_4.Orientation, Colour=swatch_6, Width=1)  # disabled
u_grid_info_3 = Panel(path_mapper_11)  # disabled
v_grid_info_3 = Panel(path_mapper_12)  # disabled
u_mullion_info_2 = Panel(path_mapper_13)  # disabled
v_mullion_info_2 = Panel(path_mapper_14)  # disabled
cgjc_2 = CurtainGridJoinCondition({"Not Defined": 0, "Vertical Grid Continuous": 1, "Horizontal Grid Continuous": 2, "Border & Vertical Grid Continuous": 3, "Border & Horizontal Grid Continuous": 4}, selected="Not Defined")  # disabled
# = Layout
# = Spacing
# = Adjust for Mullion Size
# = Grid 1 Inteiror Mullion Type
# = Start Mullion Type (Border 1)
# = End Mullion Type (Border 2)
# = Grid 2 Inteiror Mullion Type
# = Start Mullion Type (Border 1)
# = End Mullion Type (Border 2)
cgl_3 = CurtainGridLayout({"None": 0, "Fixed Distance": 1, "Fixed Number": 2, "Maximum Spacing": 3, "Minimum Spacing": 4}, selected="None")  # disabled
# = Layout
# = Spacing
# = Adjust for Mullion Size
cgl_4 = CurtainGridLayout({"None": 0, "Fixed Distance": 1, "Fixed Number": 2, "Maximum Spacing": 3, "Minimum Spacing": 4}, selected="None")  # disabled
# GRID LINES - MULLIONS AND PANELS
wall_system_family_23 = WallSystemFamily({"Basic": 0, "Curtain": 1, "Stacked": 2}, selected="Curtain")  # disabled
wall_system_family_24 = WallSystemFamily({"Basic": 0, "Curtain": 1, "Stacked": 2}, selected="Curtain")  # disabled
wall_system_family_25 = WallSystemFamily({"Basic": 0, "Curtain": 1, "Stacked": 2}, selected="Curtain")  # disabled
# GRID LINES
wall_system_family_26 = WallSystemFamily({"Basic": 0, "Curtain": 1, "Stacked": 2}, selected="Curtain")  # disabled
wall_system_family_27 = WallSystemFamily({"Basic": 0, "Curtain": 1, "Stacked": 2}, selected="Curtain")  # disabled
wall_system_family_28 = WallSystemFamily({"Basic": 0, "Curtain": 1, "Stacked": 2}, selected="Curtain")  # disabled
walls_23 = DocumentWalls(WallSystemFamily=wall_system_family_23)  # disabled
walls_24 = DocumentWalls(WallSystemFamily=wall_system_family_24)  # disabled
walls_25 = DocumentWalls(WallSystemFamily=wall_system_family_25)  # disabled
walls_26 = DocumentWalls(WallSystemFamily=wall_system_family_26)  # disabled
walls_27 = DocumentWalls(WallSystemFamily=wall_system_family_27)  # disabled
walls_28 = DocumentWalls(WallSystemFamily=wall_system_family_28)  # disabled
analyze_curtain_wall_19 = AnalyzeCurtainWall(CurtainWall=walls_23)  # -> CurtainGrid, HostWall; disabled
analyze_curtain_wall_20 = AnalyzeCurtainWall(CurtainWall=walls_24)  # -> CurtainGrid, HostWall; disabled
analyze_curtain_wall_21 = AnalyzeCurtainWall(CurtainWall=walls_25)  # -> CurtainGrid, HostWall; disabled
analyze_curtain_wall_22 = AnalyzeCurtainWall(CurtainWall=walls_26)  # -> CurtainGrid, HostWall; disabled
analyze_curtain_wall_23 = AnalyzeCurtainWall(CurtainWall=walls_27)  # -> CurtainGrid, HostWall; disabled
analyze_curtain_wall_24 = AnalyzeCurtainWall(CurtainWall=walls_28)  # -> CurtainGrid, HostWall; disabled
number_slider = Slider(1, range=0..1)  # disabled
analyze_curtain_grid_18 = AnalyzeCurtainGrid(CurtainGrid=analyze_curtain_wall_19.CurtainGrid)  # -> Cells, Mullions, Panels, VerticalLines, VerticalAngle, VerticalJustification, VerticalOffset, HorizontalLines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; disabled
number_slider_2 = Slider(0, range=0..5)  # disabled
analyze_curtain_grid_19 = AnalyzeCurtainGrid(CurtainGrid=analyze_curtain_wall_20.CurtainGrid)  # -> Cells, Mullions, Panels, VerticalLines, VerticalAngle, VerticalJustification, VerticalOffset, HorizontalLines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; disabled
analyze_curtain_grid_20 = AnalyzeCurtainGrid(CurtainGrid=analyze_curtain_wall_21.CurtainGrid)  # -> Cells, Mullions, Panels, VerticalLines, VerticalAngle, VerticalJustification, VerticalOffset, HorizontalLines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; disabled
analyze_curtain_grid_21 = AnalyzeCurtainGrid(CurtainGrid=analyze_curtain_wall_22.CurtainGrid)  # -> Cells, Mullions, Panels, VerticalLines, VerticalAngle, VerticalJustification, VerticalOffset, HorizontalLines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; disabled
analyze_curtain_grid_22 = AnalyzeCurtainGrid(CurtainGrid=analyze_curtain_wall_23.CurtainGrid)  # -> Cells, Mullions, Panels, VerticalLines, VerticalAngle, VerticalJustification, VerticalOffset, HorizontalLines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; disabled
analyze_curtain_grid_23 = AnalyzeCurtainGrid(CurtainGrid=analyze_curtain_wall_24.CurtainGrid)  # -> Cells, Mullions, Panels, VerticalLines, VerticalAngle, VerticalJustification, VerticalOffset, HorizontalLines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; disabled
a_cgl = AnalyzeCurtainGridLine(CurtainGridLine=analyze_curtain_grid_18.VerticalLines)  # -> Curve, Segments, ExistingSegments, SkippedSegments, AttachedMullions, AttachedPanels; disabled
a_cgl_2 = AnalyzeCurtainGridLine(CurtainGridLine=analyze_curtain_grid_18.HorizontalLines)  # -> Curve, Segments, ExistingSegments, SkippedSegments, AttachedMullions, AttachedPanels; disabled
a_cgl_3 = AnalyzeCurtainGridLine(CurtainGridLine=analyze_curtain_grid_19.VerticalLines)  # -> Curve, Segments, ExistingSegments, SkippedSegments, AttachedMullions, AttachedPanels; disabled
a_cgl_4 = AnalyzeCurtainGridLine(CurtainGridLine=analyze_curtain_grid_19.HorizontalLines)  # -> Curve, Segments, ExistingSegments, SkippedSegments, AttachedMullions, AttachedPanels; disabled
crv_2 = Curve(analyze_curtain_grid_21.HorizontalLines)  # disabled
crv_3 = Curve(analyze_curtain_grid_21.VerticalLines)  # disabled
a_cgl_5 = AnalyzeCurtainGridLine(CurtainGridLine=analyze_curtain_grid_22.VerticalLines)  # -> Curve, Segments, ExistingSegments, SkippedSegments, AttachedMullions, AttachedPanels; disabled
a_cgl_6 = AnalyzeCurtainGridLine(CurtainGridLine=analyze_curtain_grid_20.VerticalLines)  # -> Curve, Segments, ExistingSegments, SkippedSegments, AttachedMullions, AttachedPanels; disabled
a_cgl_7 = AnalyzeCurtainGridLine(CurtainGridLine=analyze_curtain_grid_20.HorizontalLines)  # -> Curve, Segments, ExistingSegments, SkippedSegments, AttachedMullions, AttachedPanels; disabled
item_2 = ListItem(List=analyze_curtain_grid_23.VerticalLines, Index=number_slider, Wrap=True)  # disabled
item_3 = ListItem(List=analyze_curtain_grid_23.HorizontalLines, Index=number_slider_2, Wrap=True)  # disabled
swatch_8 = ColourSwatch(SwatchColor=RGB(255, 255, 255))  # disabled
grid_cell_geom_2 = CustomPreview(Geometry=crv_3, Material=swatch_8)  # disabled
swatch_9 = ColourSwatch(SwatchColor=RGB(255, 255, 255))  # disabled
grid_cell_geom_3 = CustomPreview(Geometry=crv_2, Material=swatch_9)  # disabled
swatch_10 = ColourSwatch(SwatchColor=RGB(255, 255, 255))  # disabled
grid_cell_geom_4 = CustomPreview(Geometry=a_cgl_3.Segments, Material=swatch_10)  # disabled
swatch_11 = ColourSwatch(SwatchColor=RGB(222, 222, 222))  # disabled
grid_cell_geom_5 = CustomPreview(Geometry=a_cgl_4.Segments, Material=swatch_11)  # disabled
a_cgl_8 = AnalyzeCurtainGridLine(CurtainGridLine=item_2)  # -> Curve, Segments, ExistingSegments, SkippedSegments, AttachedMullions, AttachedPanels; disabled
a_cgl_9 = AnalyzeCurtainGridLine(CurtainGridLine=item_3)  # -> Curve, Segments, ExistingSegments, SkippedSegments, AttachedMullions, AttachedPanels; disabled
swatch_12 = ColourSwatch(SwatchColor=RGB(222, 222, 222))  # disabled
grid_cell_geom_6 = CustomPreview(Geometry=a_cgl_7.Curve, Material=swatch_12)  # disabled
swatch_13 = ColourSwatch(SwatchColor=RGB(255, 255, 255))  # disabled
grid_cell_geom_7 = CustomPreview(Geometry=a_cgl_6.Curve, Material=swatch_13)  # disabled
geometry_5 = ElementGeometry(Elements=a_cgl.AttachedMullions)  # disabled
swatch_14 = ColourSwatch(SwatchColor=RGB(76, 76, 76))  # disabled
mullion_geom = CustomPreview(Geometry=a_cgl.Curve, Material=swatch_14)  # disabled
geometry_6 = ElementGeometry(Elements=a_cgl_2.AttachedMullions)  # disabled
grid_line_curve = Panel(a_cgl_5.Curve)  # disabled
grid_line_segments = Panel(a_cgl_5.Segments)  # disabled
kept_line_segments = Panel(a_cgl_5.ExistingSegments)  # disabled
skipped_line_segments = Panel(a_cgl_5.SkippedSegments)  # disabled
attached_mullions = Panel(a_cgl_5.AttachedMullions)  # disabled
attached_panels = Panel(a_cgl_5.AttachedPanels)  # disabled
geometry_7 = ElementGeometry(Elements=a_cgl_9.AttachedPanels)  # disabled
geometry_8 = ElementGeometry(Elements=a_cgl_8.AttachedPanels)  # disabled
swatch_15 = ColourSwatch(SwatchColor=RGBA(0, 111, 255, 23))  # disabled
mullion_geom_2 = CustomPreview(Geometry=geometry_5, Material=swatch_15)  # disabled
swatch_16 = ColourSwatch(SwatchColor=RGBA(0, 242, 255, 23))  # disabled
mullion_geom_3 = CustomPreview(Geometry=geometry_6, Material=swatch_16)  # disabled
swatch_17 = ColourSwatch(SwatchColor=RGBA(255, 0, 119, 23))  # disabled
mullion_geom_4 = CustomPreview(Geometry=geometry_7, Material=swatch_17)  # disabled
swatch_18 = ColourSwatch(SwatchColor=RGBA(221, 0, 255, 23))  # disabled
mullion_geom_5 = CustomPreview(Geometry=geometry_8, Material=swatch_18)  # disabled
