# Grasshopper definition Materials_Native.ghx (Grasshopper 1.0.7)
# plug-ins: Rhino.Inside for Autodesk Revit

override = BooleanToggle(True)
color = ColourSwatch(SwatchColor=RGB(255, 132, 0))
color_2 = ColourSwatch(SwatchColor=RGB(255, 132, 0))
materials = QueryMaterials()
materials_2 = QueryMaterials(Name=";Analytical")
material = AddColorMaterial(Color=color)
material_2 = AddMaterial(Name="Orange", Override=override, Color=color_2)
panel = Panel(materials)
panel_2 = Panel(materials_2)
panel_3 = Panel(material)
panel_4 = Panel(material_2)
materials_3 = QueryMaterials(Name="Aluminum")
materials_4 = QueryMaterials(Name="Aluminum")
materials_5 = QueryMaterials(Name="Orange")
extract_material_s_assets = ExtractMaterialsAssets(Material=materials_3)  # -> ShaderAsset, PhysicalAsset, ThermalAsset
extract_material_s_assets_2 = ExtractMaterialsAssets(Material=materials_4)  # -> ShaderAsset, PhysicalAsset, ThermalAsset
panel_5 = Panel(extract_material_s_assets.ShaderAsset)
panel_6 = Panel(extract_material_s_assets.PhysicalAsset)
panel_7 = Panel(extract_material_s_assets.ThermalAsset)
r_mast = ReplaceMaterialsAssets(Material=materials_5, PhysicalAsset=extract_material_s_assets_2.PhysicalAsset)
panel_8 = Panel(r_mast)
