# Grasshopper definition revit-openings.ghx (Grasshopper 1.0.7)
# plug-ins: Rhino.Inside for Autodesk Revit

wall = Wall(<wall referenced from the Revit model>)
wall_2 = Wall(<wall referenced from the Revit model>)
point = Point(<point referenced from the Rhino model>)
point_2 = Point(<point referenced from the Rhino model>)
levels_picker = LevelsPicker(<levels picker referenced from the Revit model>)
levels_picker_2 = LevelsPicker(<levels picker referenced from the Revit model>)
add_wall_opening = AddWallOpening(Wall=[wall, wall_2], PointA=point, PointB=point_2, TrackingMode=2)
curve = Curve(<curve referenced from the Rhino model>)
floor = Floor(<floor referenced from the Revit model>)
panel = Panel(add_wall_opening)
element_geometry = ElementGeometry(Elements=floor)
opening = Opening(add_wall_opening)
host_faces = HostFaces(Host=floor)  # -> Top, Interior, Exterior, Bottom
add_shaft_opening = AddShaftOpening(
    Boundary=curve,
    BaseConstraint=levels_picker,
    BaseOffset=Slider(-3, range=-5..0),
    TopConstraint=levels_picker_2,
    TrackingMode=2)
inspect_element = InspectElement(Element=opening)  # -> ConstraintsBaseConstraint, ConstraintsBaseOffset, ConstraintsTopConstraint, ConstraintsTopOffset, ConstraintsUnconnectedHeight, PhasingPhaseCreated, PhasingPhaseDemolished
opening_boundary_profile = OpeningBoundaryProfile(Opening=opening)  # -> Plane, Profile

# ---- group: BAD
box_corners = BoxCorners(Box=opening)  # -> CornerA, CornerB, CornerC, CornerD, CornerE, CornerF, CornerG, CornerH
point_3 = Point([box_corners.CornerA, box_corners.CornerB, box_corners.CornerC, box_corners.CornerD, box_corners.CornerE, box_corners.CornerF, box_corners.CornerG, box_corners.CornerH])
colour_swatch = ColourSwatch(SwatchColor=RGB(255, 255, 255))  # disabled
custom_preview = CustomPreview(Geometry=point_3, Material=colour_swatch)  # disabled

# ----
brep = Brep(host_faces.Top)
custom_preview_2 = CustomPreview(Geometry=element_geometry, Material=ColourSwatch(SwatchColor=RGBA(255, 255, 255, 11)))
floor_2 = Floor(<floor referenced from the Revit model>)
panel_2 = Panel(add_shaft_opening)
opening_boundary_profile_2 = OpeningBoundaryProfile(Opening=add_shaft_opening)  # -> Plane, Profile
host_boundary_profile = HostBoundaryProfile(Host=floor_2)  # -> Plane, Profile
custom_preview_3 = CustomPreview(Geometry=opening_boundary_profile.Profile, Material=ColourSwatch(SwatchColor=RGB(255, 255, 255)))
panel_3 = Panel(inspect_element.PhasingPhaseDemolished)
custom_preview_4 = CustomPreview(
    Geometry=[host_boundary_profile.Profile, opening_boundary_profile_2.Profile],
    Material=ColourSwatch(SwatchColor=RGB(255, 255, 255)))
graphical_element = GraphicalElement([<floor referenced from the Revit model> x3, <ceiling referenced from the Revit model>])
graphical_element_2 = GraphicalElement(<roof referenced from the Revit model>)
built_in_categories = BuiltInCategories(
    ["autodesk.revit.category.local:arcWallRectOpening-1.0.0", "autodesk.revit.category.local:sWallRectOpening-1.0.0"],
    LayoutLevel=2,
    SearchPattern="?Opening")
built_in_categories_2 = BuiltInCategories("autodesk.revit.category.local:shaftOpening-1.0.0", LayoutLevel=2, SearchPattern="?Opening")
wall_3 = Wall(<wall referenced from the Revit model>)
wall_4 = Wall(<wall referenced from the Revit model>)
roof = Roof(<roof referenced from the Revit model>)
floor_3 = Floor(<floor referenced from the Revit model>)
wall_5 = Wall(<wall referenced from the Revit model>)
levels_picker_3 = LevelsPicker(<levels picker referenced from the Revit model>)
roof_2 = Roof(<roof referenced from the Revit model>)
roof_3 = Roof(<roof referenced from the Revit model>)
levels_picker_4 = LevelsPicker(<levels picker referenced from the Revit model>)
levels_picker_5 = LevelsPicker(<levels picker referenced from the Revit model>)
levels_picker_6 = LevelsPicker(<levels picker referenced from the Revit model>)
wall_6 = Wall(<wall referenced from the Revit model>)
point_4 = Point(<point referenced from the Rhino model>)
point_5 = Point(<point referenced from the Rhino model>)
host_inserts = HostInserts(Host=roof_2)  # -> Inserts, Shared, Shadows, Openings, Walls
host_inserts_2 = HostInserts(Host=wall_3)  # -> Inserts, Shared, Shadows, Openings, Walls
host_inserts_3 = HostInserts(Host=wall_4)  # -> Inserts, Shared, Shadows, Openings, Walls
host_inserts_4 = HostInserts(Host=roof)  # -> Inserts, Shared, Shadows, Openings, Walls
host_inserts_5 = HostInserts(Host=floor_3)  # -> Inserts, Shared, Shadows, Openings, Walls
host_inserts_6 = HostInserts(Host=wall_5)  # -> Inserts, Shared, Shadows, Openings, Walls
host_inserts_7 = HostInserts(Host=roof_3)  # -> Inserts, Shared, Shadows, Openings, Walls
add_wall_opening_2 = AddWallOpening(Wall=wall_6, PointA=point_4, PointB=point_5, TrackingMode=2)
category_filter = CategoryFilter(Categories=built_in_categories, Inverted=False)
category_filter_2 = CategoryFilter(Categories=built_in_categories_2, Inverted=False)
curve_2 = Curve(<curve referenced from the Rhino model>)
curve_3 = Curve(<curve referenced from the Rhino model>)
value_picker = ValuePicker(host_inserts.Openings)
value_picker_2 = ValuePicker(host_inserts_7.Openings)
panel_4 = Panel(host_inserts_4.Openings)
panel_5 = Panel(host_inserts_3.Openings)
panel_6 = Panel(host_inserts_5.Openings)
opening_boundary_profile_3 = OpeningBoundaryProfile(Opening=host_inserts_6.Openings)  # -> Plane, Profile
inspect_element_2 = InspectElement(Element=host_inserts_2.Openings)  # -> ConstraintsBaseConstraint, ConstraintsBaseOffset, ConstraintsTopConstraint, ConstraintsTopOffset, ConstraintsUnconnectedHeight, PhasingPhaseCreated, PhasingPhaseDemolished
panel_7 = Panel(add_wall_opening_2)
add_shaft_opening_2 = AddShaftOpening(Boundary=curve_2, BaseConstraint=levels_picker_3, TopConstraint=levels_picker_6, TrackingMode=2)
query_elements = QueryElements(Filter=category_filter, Limit=100)  # -> Elements, Count
query_elements_2 = QueryElements(Filter=category_filter_2, Limit=100)  # -> Elements, Count
add_shaft_opening_3 = AddShaftOpening(
    Boundary=curve_3,
    BaseConstraint=levels_picker_5,
    BaseOffset=Slider(-3, range=-5..0),
    TopConstraint=levels_picker_4,
    TopOffset=Slider(3, range=0..5),
    TrackingMode=2)
panel_8 = Panel(opening_boundary_profile_3.Profile)
opening_boundary_profile_4 = OpeningBoundaryProfile(Opening=value_picker)  # -> Plane, Profile
inspect_element_3 = InspectElement(Element=value_picker_2)  # -> PhasingPhaseCreated, PhasingPhaseDemolished
panel_9 = Panel(query_elements.Elements)
panel_10 = Panel(query_elements_2.Elements)
panel_11 = Panel(add_shaft_opening_2)
panel_12 = Panel([inspect_element_2.ConstraintsBaseConstraint, inspect_element_2.ConstraintsBaseOffset, inspect_element_2.ConstraintsTopConstraint, inspect_element_2.ConstraintsTopOffset, inspect_element_2.ConstraintsUnconnectedHeight])
phase = Phase(inspect_element_2.PhasingPhaseCreated)
panel_13 = Panel(add_shaft_opening_3)
panel_14 = Panel(opening_boundary_profile_4.Profile)
panel_15 = Panel(phase)
built_in_categories_3 = BuiltInCategories("autodesk.revit.category.local:arcWallRectOpening-1.0.0", LayoutLevel=2, SearchPattern="?Opening")
built_in_categories_4 = BuiltInCategories("autodesk.revit.category.local:floors-1.0.0", LayoutLevel=2, SearchPattern="Floors")
floor_4 = Floor(<floor referenced from the Revit model>)
host_faces_2 = HostFaces(Host=floor_4)  # -> Top, Interior, Exterior, Bottom
opening_2 = Opening(<opening referenced from the Revit model>)
brep_2 = Brep(host_faces_2.Top)
category_filter_3 = CategoryFilter(Categories=built_in_categories_3, Inverted=False)
bounding_box_filter = BoundingBoxFilter(BoundingBox=opening_2, Union=True, Strict=False, Tolerance=0, Inverted=False)  # -> Filter, Target
category_filter_4 = CategoryFilter(Categories=built_in_categories_4, Inverted=False)
query_elements_3 = QueryElements(Filter=category_filter_3, Limit=100)  # -> Elements, Count
logical_and_filter = LogicalAndFilter(FilterA=bounding_box_filter.Filter, FilterB=category_filter_4)
element_host = ElementHost(Element=query_elements_3.Elements)
query_elements_4 = QueryElements(Filter=logical_and_filter, Limit=100)  # -> Elements, Count
panel_16 = Panel(element_host)
panel_17 = Panel(query_elements_4.Elements)
